# Grasshopper definition 01_Embroidery_Pipeline_wip.gh (Grasshopper 1.0.8)
# plug-ins: HorseshoeGH, Human, Whale

# ----
# Load Guids(Curves in Named Layers)
id = Guid([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])

# ----
# Input Parameters
reload = Button()
overwrite = BooleanToggle(False)
save_overwritten = Button()

knob = ControlKnob(Decimals=0, Limit=True, Maximum=10, Minimum=0, Range=10, Value=0)
list = ValueList({"Embroidery Thread Stitching": "ETS", "Embroidery Cable Stitching": "ECS", "Embroidery Flywire Stitching": "EFS", "Embroidery Winding Traveling": "EWT"}, selected="Embroidery Thread Stitching")
colorids = Slider(9, range=1..10)
stitchlens = Slider(26, range=10..120)
patternwids = Slider(41, range=10..120)
patterntypes = ValueList({"none": 0, "zigzag": 1, "cross": 2, "decorative": 3, "arrow": 4, "feather": 5}, selected="feather")
merge = Merge(Data1=knob, Data2=list, Data3=colorids, Data4=patterntypes, Data5=stitchlens, Data6=patternwids, Data7="ADD_ts_fs_test")
panel = Panel(merge)

# ----
# Do Pattern
do_pattern = BooleanToggle(False)

# ----
# .DST File Name
panel_2 = Panel("KBM_knit_L")

exportdst = Button()

number_slider = Slider(1000, range=0..3000)
nameme = MyPythonEditer(n=number_slider)  # -> out, pts; inputs n: Int32
# ---------- nameme: Python ----------
__author__ = "Yen-Fen Chan"
__version__ = "0.0.1"
__date__ = '2024.00.00'
__updated__ = '2024.00.00'

import Rhino.Geometry as rg
import ghpythonlib.treehelpers as th
import random


pts = [rg.Point3d(random.uniform(0, 100),
                  random.uniform(0, 100),
                  0) for _ in range(n)]

# pts = []
# # 一個 50×50 的小區域擠 100 個點 (密度遠超 k=12)
# for _ in range(int(n/2)):
#     pts.append(rg.Point3d(random.uniform(0, 50),
#                           random.uniform(0, 50), 0))
# # 其他點正常散布
# for _ in range(int(n/2)):
#     pts.append(rg.Point3d(random.uniform(0, 1000),
#                           random.uniform(0, 1000), 0))
# ---------- end nameme ----------
Y = UnitY(Factor=1)
multiplication = Multiplication(A=Y, B="2")
move = Move(Geometry=nameme.pts, Motion=multiplication)  # -> Geometry, Transform
random = Random(Range="0 to 360", Number=number_slider, Seed=2)
ln = Line(StartPoint=nameme.pts, EndPoint=move.Geometry)  # -> flatten(Line)
rotate = Rotate(Geometry=ln, Angle=degrees(random), Plane=nameme.pts)  # -> flatten(Geometry), Transform
path_mapper = PathMapper(rotate.Geometry, source="{x}", target="{0;x}")
crv = Curve(path_mapper)

# ----
# Data Streaming
# Sequence - Type - Color - Pattern - StitchLength - PatternWidth
rhstream = Script(referenced_guids=id, reload=reload, overwrite=overwrite, save_ow=save_overwritten, params_ow=panel)  # -> out, out_curves, out_layerNames, port, out_stitchLens, out_types, out_colors, out_patterns, out_wids; inputs referenced_guids: list of Guid, reload: Boolean, overwrite: Boolean, save_ow: Boolean, params_ow: list of String
# ---------- rhstream: Python ----------
__author__ = "fen.chan"
__version__ = "2024.05.14"
__update__ = "2026.03.12"

import System
import Rhino
import Rhino.Geometry as rg
import Grasshopper
import scriptcontext as sc
import ghpythonlib.treehelpers as th
from typing import NamedTuple, List, Optional, Tuple
from collections import OrderedDict

# ==============================================================================
# 1. Settings Parser (Data Structure)
# ==============================================================================

class LayerSettings(NamedTuple):
    """
    Parses and holds embroidery settings from a layer name string.
    Format: Order_Type_Color_Pattern_Len_Wid_Comment
    """
    order: int
    type_code: str
    color_id: int
    pattern_id: int
    stitch_len: float
    pattern_wid: float
    comment: str

    @classmethod
    def from_string(cls, layer_name: str) -> Optional['LayerSettings']:
        parts = layer_name.split('_')
        if len(parts) < 6:
            return None
        try:
            return cls(
                order       = int(parts[0]),
                type_code   = parts[1],
                color_id    = int(parts[2]),
                pattern_id  = int(parts[3]),
                stitch_len  = float(parts[4]) * 0.1,
                pattern_wid = float(parts[5]) * 0.1,
                comment     = "_".join(parts[6:]) if len(parts) > 6 else ""
            )
        except ValueError:
            return None

# ==============================================================================
# 2. Main Stream Class
# ==============================================================================

class RhStream:
    RHINO_DOC = Rhino.RhinoDoc.ActiveDoc

    def __init__(self, referenced_guids: List[System.Guid]):
        self.RH_guids = referenced_guids
        self.valid_pairs = []  # Holds (Curve, LayerName, LayerSettings)
        
        # Will be populated during extraction
        self.unique_orders = set()
        self.curve_counts = {}

    def _extract_rhino_objects(self):
        if not self.RH_guids:
            return []
        
        extracted_data = []
        for guid in self.RH_guids:
            rh_obj = self.RHINO_DOC.Objects.Find(guid)
            if rh_obj is None:
                continue 
            
            layer_index = rh_obj.Attributes.LayerIndex
            layer_name = self.RHINO_DOC.Layers[layer_index].Name
            
            geometry = rh_obj.Geometry
            
            if isinstance(geometry, rg.Curve):
                extracted_data.append((geometry, layer_name))

        return extracted_data

    def _init_sticky_parameters(self):
        """Initializes or retrieves the sticky dictionary based on parsed orders."""
        self.overwrite_parameters = sc.sticky.get('overwrite_parameters', {})
        
        # Ensure all current orders exist in the sticky dict
        for order in self.unique_orders:
            if order not in self.overwrite_parameters:
                self.overwrite_parameters[order] = {
                    "parameters": {"order": order,"type_code": None, 
                                   "color_id": None, "pattern_id": None, 
                                   "stitch_len": None, "pattern_wid": None, 
                                   "comment": None},
                    "overwritten": False
                }
        # Update sticky globally
        sc.sticky['overwrite_parameters'] = self.overwrite_parameters

    def save_overwritten(self, name_str: str):
        """Updates sticky with new parameters from a string (e.g., '0_EMB_1_3_50_50_jig')"""
        params = name_str.split("_")
        if len(params) < 6:
            print("Overwrite failed: Parameter string format incorrect.")
            return

        try:
            ix = int(params[0])
            if ix in self.overwrite_parameters:
                self.overwrite_parameters[ix]["parameters"]["order"] = ix
                self.overwrite_parameters[ix]["parameters"]["type_code"] = str(params[1])
                self.overwrite_parameters[ix]["parameters"]["color_id"] = int(params[2])
                self.overwrite_parameters[ix]["parameters"]["pattern_id"] = int(params[3])
                self.overwrite_parameters[ix]["parameters"]["stitch_len"] = float(params[4]) * 0.1
                self.overwrite_parameters[ix]["parameters"]["pattern_wid"] = float(params[5]) * 0.1
                self.overwrite_parameters[ix]["parameters"]["comment"] = "_".join(params[6:]) if len(params) > 6 else ""
                
                self.overwrite_parameters[ix]["overwritten"] = True
                sc.sticky['overwrite_parameters'] = self.overwrite_parameters
                print("Successfully overwritten parameters for Layer Order: {}".format(ix))
        except ValueError:
            print("Overwrite failed: Could not parse numerical values.")

    def reset_overwrite_parameters(self):
        """Clears the overwrite status for all tracked orders."""
        if hasattr(self, 'overwrite_parameters'):
            for ix in self.overwrite_parameters:
                self.overwrite_parameters[ix]["overwritten"] = False
            sc.sticky['overwrite_parameters'] = self.overwrite_parameters
            print("overwrite_parameters have been reset to original layer settings.")

    def group_curves_by_indices(self, curves, indices):
        if len(curves) != len(indices):
            raise ValueError("The number of curves must match the number of indices.")
        groups = {}
        for i, group_idx in enumerate(indices):
            if group_idx not in groups:
                groups[group_idx] = []
            groups[group_idx].append(curves[i])
            
        sorted_keys = sorted(groups.keys())
        return [groups[key] for key in sorted_keys]

    def display_info(self):
        divider = 80
        print("Imported Design Information")
        print("{}".format("=" * divider))
        print("{}".format(" " * divider))

        for order in sorted(self.unique_orders):
            is_overwritten = self.overwrite_parameters[order]["overwritten"]
            
            # Find the original settings for this order to display
            orig_settings = next((p[2] for p in self.valid_pairs if p[2].order == order), None)
            
            print("Layer Order: {}".format(order))

            print("Curve Count : {}".format(self.curve_counts.get(order, 0)))
            print("Overwritten : {}".format(is_overwritten))
            
            if is_overwritten:
                print("Active Params: {}".format(self.overwrite_parameters[order]["parameters"]))
                # print("Orig. Params : {}".format(orig_settings._asdict() if orig_settings else "None"))
            else:
                print("Active Params: {}".format(orig_settings._asdict() if orig_settings else "None"))
                
            print("{}".format(" " * divider))
            print("{}".format("-" * divider))
            print("{}".format(" " * divider))
        print("Done.")

    def get_data(self, toSort: bool, reload_input: bool) -> Tuple[list, ...]:
        if reload_input or not self.RH_guids:
            return (None,) * 8

        self.valid_pairs = []
        self.unique_orders = set()
        self.curve_counts = {}

        raw_data = self._extract_rhino_objects()
        
        for curve, layer_name in raw_data:
            settings = LayerSettings.from_string(layer_name)
            if settings:
                self.valid_pairs.append((curve, layer_name, settings))
                self.unique_orders.add(settings.order)
                self.curve_counts[settings.order] = self.curve_counts.get(settings.order, 0) + 1

        if not self.valid_pairs:
            return ([], [], [], [], [], [], [], [])

        self._init_sticky_parameters()

        if toSort:
            self.valid_pairs.sort(key=lambda x: x[2].order)

        sorted_curves = []
        sorted_layer_names = []
        sorted_orders = []
        sorted_types = []
        sorted_color_ids = []
        sorted_pattern_ids = []
        sorted_stitch_lens = []
        sorted_pattern_wids = []

        for curve, layer_name, orig_settings in self.valid_pairs:
            order = orig_settings.order
            ow_data = self.overwrite_parameters.get(order, {})
            
            sorted_curves.append(curve)
            sorted_orders.append(order)
            
            # 🛑 核心修復：根據 Overwrite 狀態決定要輸出的 Layer Name
            if ow_data.get("overwritten"):
                p = ow_data["parameters"]
                
                # 重建被覆寫的圖層名稱字串
                name_parts = [
                    str(order),
                    str(p["type_code"]),
                    str(p["color_id"]),
                    str(p["pattern_id"]),
                    str(int(p["stitch_len"] * 10)),  # 轉回整數 0.1mm 單位
                    str(int(p["pattern_wid"] * 10))
                ]
                if p.get("comment"):
                    name_parts.append(str(p["comment"]))
                
                sorted_layer_names.append("_".join(name_parts)) # 寫入新名字
                
                sorted_types.append(p["type_code"])
                sorted_color_ids.append(p["color_id"])
                sorted_pattern_ids.append(p["pattern_id"])
                sorted_stitch_lens.append(p["stitch_len"])
                sorted_pattern_wids.append(p["pattern_wid"])
            else:
                # 沒被覆寫，乖乖用 Rhino 原本的資料
                sorted_layer_names.append(layer_name)
                
                sorted_types.append(orig_settings.type_code)
                sorted_color_ids.append(orig_settings.color_id)
                sorted_pattern_ids.append(orig_settings.pattern_id)
                sorted_stitch_lens.append(orig_settings.stitch_len)
                sorted_pattern_wids.append(orig_settings.pattern_wid)

        grouped_curves = self.group_curves_by_indices(sorted_curves, sorted_orders)
        tree_curves = th.list_to_tree(grouped_curves)

        return (
            tree_curves,
            sorted_layer_names,
            sorted_orders,
            sorted_types,
            sorted_color_ids,
            sorted_pattern_ids,
            sorted_stitch_lens,
            sorted_pattern_wids
        )

# ==============================================================================
# 3. Execution Block (Grasshopper)
# ==============================================================================

if __name__ == "__main__":
    
    out_curves = []
    out_layerNames = []
    out_orders = []
    out_types = []
    out_colors = []
    out_patterns = []
    out_stitchLens = []
    out_wids = []

    if reload_:
        sc.sticky.clear()
        

    elif referenced_guids:
        rhs = RhStream(referenced_guids)
        
        # --- 步驟 1: 預先載入資料與初始化快取 ---
        # 呼叫一次 get_data 純粹為了讀取 Rhino 圖層並建立 Sticky 字典
        # (請確保你已經在 get_data 函式內加入了 self.valid_pairs = [] 來防止數量倍增)
        rhs.get_data(toSort=False, reload_input=reload_) 

        # --- 步驟 2: 狀態判斷邏輯 ---
        if overwrite_:
            # 當 Toggle = True 時：只在「按下 Button」的瞬間執行存檔
            if save_ow and params_ow:
                name_str = "_".join(params_ow)
                rhs.reset_overwrite_parameters()
                rhs.save_overwritten(name_str)
            # 若 save_ow 為 False (鬆開狀態)，這裡什麼都不做，完美保持現狀
        else:
            # 當 Toggle = False 時：強制清空所有快取，回歸原始圖層
            rhs.reset_overwrite_parameters()

        # --- 步驟 3: 正式輸出 ---
        # 根據步驟 2 處理完的最新 Sticky 狀態，重新整理並打包輸出資料
        (
        out_curves,
        out_layerNames,
        out_orders,
        out_types,
        out_colors,
        out_patterns,
        out_stitchLens,
        out_wids
        ) = rhs.get_data(toSort=True, reload_input=reload_)

        # 在 Grasshopper 面板顯示資訊 (建議把分隔線改成 "━" * 80 會清楚很多)
        rhs.display_info()
# ---------- end rhstream ----------

panel_3 = Panel(rhstream.out)
py3 = Python3Script()  # -> out, a
# ---------- py3: Python ----------
import sys
import os

# 把 src/script 加進模組搜尋路徑
SCRIPT_DIR = "/Users/chanyenfen/Library/Mobile Documents/com~apple~CloudDocs/1_1_Projects/digital-stitch-pipeline/src/script"
if SCRIPT_DIR not in sys.path:
    sys.path.insert(0, SCRIPT_DIR)

# 現在才 import
import native_bridge
import geometry_utils

native_bridge.load_dll()
print("dylib loaded OK on Mac")
# ---------- end py3 ----------
nameme_2 = MyPythonEditer(crvs=crv)  # -> out, chained; inputs crvs: list of Curve
# ---------- nameme_2: Python ----------
__author__ = "Yen-Fen Chan"
__version__ = "0.0.1"
__date__ = '2024.00.00'
__updated__ = '2024.00.00'

import Rhino.Geometry as rg
from typing import Iterable, List

def chain_curves(curves: Iterable[rg.Curve],
                 close_loop: bool = False
                ) -> List[rg.Curve]:
    """
    Chain a sequence of curves by inserting straight connectors between each
    curve’s end and the next curve’s start.

    :param curves: An iterable of Rhino.Geometry.Curve
    :param close_loop: If True, also connect the last curve back to the first.
    :return: A list of rg.Curve objects, alternating original curves and connector segments.
    """
    # Snapshot into a list so we can index and check length
    n = len(curves)
    if n == 0:
        return []
    if n == 1:
        return [crvs[0]]

    chained: List[rg.Curve] = []
    # chain between each pair
    for c1, c2 in zip(crvs[:-1], crvs[1:]):
        chained.append(c1)
        # create line connector and convert to NurbsCurve
        seg = rg.Line(c1.PointAtEnd, c2.PointAtStart)
        chained.append(seg.ToNurbsCurve())

    # append the last input curve
    chained.append(crvs[-1])

    # optionally close the loop
    if close_loop:
        seg = rg.Line(crvs[-1].PointAtEnd, crvs[0].PointAtStart)
        chained.append(seg.ToNurbsCurve())

    return chained


chained = chain_curves(crvs)
# ---------- end nameme_2 ----------

# ----
# Do NOT change
joinends = BooleanToggle(True)
overlap = BooleanToggle(False)

end = EndPoints(Curve=crv)  # -> Start, End
pt = Point(end.Start)
previewlw = CustomPreviewLineweights(
    Geometry=crv,
    Shader={diffuse=RGB(255, 105, 180), emission=RGB(76, 32, 54), shine=0.5, specular=RGB(255, 255, 255), transparency=0},
    Thickness=Slider(2, range=0..10),
    Absolute=False)
pt_2 = ConstructPoint(XCoordinate=0, YCoordinate=0, ZCoordinate=0)

# ---- group: Length Comparison
len = Length(Curve=crv)
len_2 = Length(Curve=nameme_2.chained)
ma = MassAddition(Input=len)  # -> Result, PartialResults
ma_2 = MassAddition(Input=len_2)  # -> Result, PartialResults
total_trajectory_length = Panel(ma.Result)
total_design_length = Panel(ma_2.Result)
subtraction = Subtraction(A=total_design_length, B=total_trajectory_length)
total_traveling_length = Panel(subtraction)

# ----
swatch = ColourSwatch(SwatchColor=RGBA(0, 255, 255, 0))  # disabled
swatch_2 = ColourSwatch(SwatchColor=RGB(255, 25, 116))  # disabled
panel_4 = Panel("4")  # disabled
panel_5 = Panel("6")  # disabled
swatch_3 = ColourSwatch(SwatchColor=RGB(255, 255, 255))  # disabled
swatch_4 = ColourSwatch(SwatchColor=RGB(255, 25, 116))  # disabled

# ----
# Digital Embroidery Workflow
# Scripts
panel_6 = Panel("misc.py")
entwine = Entwine(
    Branch00=panel_6,
    Branch01="patternfilter.py",
    Branch02="geometry_utils.py",
    Branch03="emb_prepro.py",
    Branch04="emb_write_dst.py",
    FlattenInputs=True)  # -> flatten(Result)

# ---- group: script directory
S = Script(modules=entwine)  # -> script_dirs, patterns; inputs modules: list
# ---------- S: Python ----------
import sys
import os
import Grasshopper


# 1. Get the current Grasshopper file location
# This accesses the document that owns this component
gh_doc = ghenv.Component.OnPingDocument()

if gh_doc.FilePath:
    gh_file_path = gh_doc.FilePath
    gh_dir = os.path.dirname(gh_file_path)      # ...\src\gh
    project_root = os.path.dirname(gh_dir)      
    
    script_dirs = []
    patterns = [i for i in range(len(modules))]
    
    
    for module in modules:
        script_dir = os.path.normpath(os.path.join(project_root, "script", module))
        script_dirs.append(script_dir)

        if script_dir not in sys.path:
            sys.path.append(script_dir)
# ---------- end S ----------

# ----
item = ListItem(List=S.script_dirs, Index=0, Wrap=True)  # -> Item, Item1, Item2, Item3, Item4

# ----
# Path Planning
ordercurves = MyPythonEditer(script=item.Item2, curves_tree=crv, if_flip=Toggle(True), native_sort=Toggle(True))  # -> out, out_curves_tree; inputs curves_tree: tree of Curve, if_flip: Boolean, native_sort: Boolean
#   port script: Script to execute
# ---------- ordercurves: Python ----------
__author__ = "Yen-Fen Chan"
__version__ = "0.1.0" # Updated to R-Tree version
__date__ = '2026.03.05'

import Rhino.Geometry as rg

def sort_curves_by_rtree_optimized(curves, start_point =rg.Point3d(0,0,0)):
    """
    使用 R-Tree 優化的貪婪路徑排序演算法。
    起始點設定為離 (0,0,0) 最近的曲線端點。
    """
    if not curves:
        return [], []
    
    # 1. 建立 R-Tree 與點位快取 (避免迴圈內重複存取 Rhino Object 屬性)
    id_to_point = {}
    rtree = rg.RTree()
    
    for i, c in enumerate(curves):
        start = c.PointAtStart
        end = c.PointAtEnd
        
        # 偶數 ID 代表 Start, 奇數 ID 代表 End
        s_id, e_id = i * 2, i * 2 + 1
        
        rtree.Insert(start, s_id)
        rtree.Insert(end, e_id)
        
        id_to_point[s_id] = start
        id_to_point[e_id] = end

    # 2. 尋找起始曲線：離 (0,0,0) 最近的端點
    first_idx = -1
    min_dist_to_sp = float("inf")
    first_is_rev = False

    for i, c in enumerate(curves):
        d_s = start_point.DistanceTo(c.PointAtStart)
        d_e = start_point.DistanceTo(c.PointAtEnd)
        
        if d_s < min_dist_to_sp:
            min_dist_to_sp = d_s
            first_idx = i
            first_is_rev = False
        if d_e < min_dist_to_sp:
            min_dist_to_sp = d_e
            first_idx = i
            first_is_rev = True

    # 初始化排序容器
    ordered_indices = [first_idx]
    reversals = [first_is_rev]
    used_indices = {first_idx}
    
    # 決定目前的最後一點位置
    last_pt = curves[first_idx].PointAtStart if first_is_rev else curves[first_idx].PointAtEnd

    # 3. 核心 R-Tree 搜尋迴圈
    while len(ordered_indices) < len(curves):
        # 使用 list 存儲最佳結果以供 callback 修改
        # [best_idx, best_dist, need_reverse]
        best_match = [-1, float("inf"), False]

        def search_callback(sender, e):
            idx = e.Id // 2
            if idx in used_indices: 
                return
            
            this_pt = id_to_point[e.Id]
            dist = last_pt.DistanceTo(this_pt)
            
            if dist < best_match[1]:
                best_match[1] = dist
                best_match[0] = idx
                best_match[2] = (e.Id % 2 == 1) # 如果撞到對方的 End，則該線需反轉

        # 執行 R-Tree 搜尋 (使用足夠大的球體範圍)
        rtree.Search(rg.Sphere(last_pt, 1000000), search_callback)

        next_idx = best_match[0]
        if next_idx == -1: 
            break # 防止異常中斷
        
        used_indices.add(next_idx)
        ordered_indices.append(next_idx)
        
        need_rev = best_match[2]
        reversals.append(need_rev)
        
        # 更新最後一點
        next_curve = curves[next_idx]
        last_pt = next_curve.PointAtStart if need_rev else next_curve.PointAtEnd

    # 4. 根據排序結果重建幾何物件
    ordered_curves = []
    for idx, rev in zip(ordered_indices, reversals):
        new_c = curves[idx].Duplicate()
        if rev: 
            new_c.Reverse()
        ordered_curves.append(new_c)

    return ordered_curves, ordered_indices

# --- 執行排序 ---
sorted_paths, ori_indices = sort_curves_by_rtree_optimized(unsorted_paths, start_point=rg.Point3d(31.9,80,0))
# ---------- end ordercurves ----------

panel_7 = Panel(ordercurves.out)

nameme_3 = MyPythonEditer(crvs=ordercurves.out_curves_tree)  # -> out, chained; inputs crvs: list of Curve; same code as nameme_2

crv_2 = Curve(flatten(ordercurves.out_curves_tree))
dividecurves = IronPython2Script(
    curves=crv_2,
    segment_lengths=rhstream.out_stitchLens,
    join_ends=joinends,
    overlap=overlap,
    overlap_length=Slider(0, range=0..10))  # -> out, pts_tree, pts_nested; inputs curves: list of Curve, segment_lengths: list of Double, join_ends: Boolean, overlap: Boolean, overlap_length: Double
# ---------- dividecurves: IronPython ----------
__author__ = "fen.chan"
__version__ = "2023.11.15"
                        
import Rhino.Geometry as rg
import ghpythonlib.treehelpers as th
import math as m

class DivideCurves():
    TMIN = float(0.0)
    MAX_SEG_LENGTH = 300
    def __init__(self, curves):
        """Initialize the DivideCurves class"""
        self.curves = curves

    def get_item(self, index):
        """Get the curve at the specified index"""
        try:
            return self.curves[index]
        except IndexError:
            print ("get_item: index out of range:%s"%index)

    def set_crv_domain(self, crv):
        """Set the domain of the curve from 0 to its length"""
        t_max = crv.GetLength()
        crv.Domain = rg.Interval(float(self.TMIN),float(t_max))

    def get_divide_count(self, curve, segment_length):
        if segment_length > self.MAX_SEG_LENGTH:
            return 1
        count = max(1, int(m.ceil(curve.GetLength() / segment_length)))
        return count

    def get_parameters(self,crv,count,endInc=True):
        params = list(crv.DivideByCount(count,endInc))
        return params

    def check_closed(self,crv):
        return True if crv.IsClosed else False

    def check_explodable(self, crv):
        tMin = self.TMIN
        t_max = crv.GetLength()
        getNext = True
        count = 0
        dc = rg.Continuity.G2_continuous
        while getNext:
            getNext, t = rg.Curve.GetNextDiscontinuity(crv, dc,tMin,t_max)
            count+=1
            if getNext:
                tMin=t
        if count>0:return True 
        else:return False

    def get_curve_segments(self, crv):
        return crv.DuplicateSegments() if self.check_explodable(crv) else [crv]

    def flatten_list(self, l):
        return [item for sublist in l for item in sublist]

    def get_division_pts(self, crv, params):
        division_pts =[crv.PointAt(p) for p in params]
        return division_pts

    def get_division_normals(self, crv, params):
        division_tangents =[crv.TangentAt(p) for p in params]
        division_normals = [rg.Vector3d.CrossProduct(v, rg.Vector3d.ZAxis) for v in division_tangents]
        return division_normals

    def get_overlap(self, pts, overlap_length, joinEnds):
        """Evaluate if the overlap_length is set higher than the distant of first and last point"""
        if joinEnds: check = rg.Point3d.DistanceTo(pts[1], pts[0])
        else: check = rg.Point3d.DistanceTo(pts[0], pts[-1])
        if overlap_length > check: 
            overlap_length = check
            print ("get_overlap: overlap_length can't be higher than %s"%overlap_length)
        if overlap_length <= check:
            if joinEnds: dir = pts[1]-pts[0]
            else      : dir = pts[0]-pts[-1]
            dir.Unitize()
            new_pt = rg.Point3d.Add(pts[-1], dir*overlap_length)
            pts.append(new_pt)


if __name__ == "__main__":
    dc = DivideCurves(curves)
    pts_nested=[]
    pts_tree = []
    """Iterate through all input curves and explode each into segments if possible"""
    for i in range(len(dc.curves)):
        crv = dc.get_item(i) 
        segs = dc.get_curve_segments(crv)
        crv_pts = []
        """Iterate through all segments and convert NURBS ones to POLYLINE, 
           then set their DOMAIN accroding to the length                """
        for j,seg in enumerate(segs):
            dc.set_crv_domain(seg)
            count = dc.get_divide_count(seg,segment_lengths[i])
            params = dc.get_parameters(seg, count,True)
            #closed curve
            if dc.check_closed(crv):
                if join_ends:#first pt is last pt
                    if len(segs)==1:
                        params.append(params[0])
                    elif len(segs)!=1:
                        if j!=len(segs)-1: params.pop()
                else:#first pt is not last pt
                    if len(segs)!=1:
                        params.pop()
            #open curve
            else:
                if len(segs)!=1 and j!=len(segs)-1:
                    params.pop()

            seg_pts = dc.get_division_pts(seg,params)
            #optional normals exported 
            #optional list types
            crv_pts.extend(seg_pts)
        
        """Adding an additional point to the last for overlapping.
           It only applies to closed curve                    """
        if overlap and dc.check_closed(crv):
            dc.get_overlap(crv_pts,overlap_length,joinEnds)
            
        pts_nested.append(crv_pts)
    pts_tree = th.list_to_tree(pts_nested)
# ---------- end dividecurves ----------

# ---- group: Length Comparison
len_3 = Length(Curve=crv)
len_4 = Length(Curve=nameme_3.chained)
ma_3 = MassAddition(Input=len_3)  # -> Result, PartialResults
ma_4 = MassAddition(Input=len_4)  # -> Result, PartialResults
total_trajectory_length_2 = Panel(ma_3.Result)
total_design_length_2 = Panel(ma_4.Result)
subtraction_2 = Subtraction(A=total_design_length_2, B=total_trajectory_length_2)
total_traveling_length_2 = Panel(subtraction_2)

# ----
# Sample Points from Curves
patternfilter = Python3Script(
    script=item.Item1,
    pts_nested=dividecurves.pts_nested,
    pattern_sorted=rhstream.out_patterns,
    width_sorted=rhstream.out_wids,
    do_pattern=do_pattern)  # -> out, vis, patternPts_nested

# ----
# Embroidery Stitch Preprocessor
emb_preprocessor = Script(
    script=item.Item3,
    pts_nested=patternfilter.patternPts_nested,
    sorted_types=rhstream.out_types,
    sorted_colors=rhstream.out_colors)  # -> out, zpts_tree, out_dict; inputs pts_nested: list, sorted_types: list of String, sorted_colors: list of Int32, mirror: Boolean
#   port script: Script to execute
# ---------- emb_preprocessor: Python ----------
"""
Python 3 script for Rhino 8 Grasshopper
Geometry Pre-processing for Embroidery & Winding.
OrderedDict: Pure Data for Export | zpts_tree: Full Visual for Preview.
"""
__author__ = "fen.chan"
__version__ = "2026.03.03"

import Rhino.Geometry as rg
import ghpythonlib.treehelpers as th
from itertools import zip_longest
from collections import OrderedDict

# =========================================================
# Parameters & Constants
# =========================================================
JUMP_THRESHOLD = 121   # 12.1mm (unit 0.1mm)
TIE_OFFSET = 1         # 0.5mm  (unit 0.1mm)
cap_distance = 0.5
jump_vec = rg.Vector3d(0, 0, 50)
origin = rg.Point3d(0, 0, 0)

# =========================================================
# Helper Functions (Geometry Generation)
# =========================================================

def create_cap_pts(start_pt, end_pt, dist):
    vec = end_pt - start_pt
    if vec.Length == 0: return [rg.Point3d(start_pt)]
    vec.Unitize()
    normal = rg.Vector3d.CrossProduct(vec, rg.Vector3d.ZAxis)
    normal.Unitize()
    
    # 這裡產生的點都是新的 Instance
    p_side = start_pt + (normal * dist)
    p_fwd = start_pt + (vec * dist)
    return [rg.Point3d(start_pt), p_side, p_fwd, rg.Point3d(start_pt)]

def create_linear_tie(pt, vector, offset_dist):
    if vector.IsZero: vector = rg.Vector3d.XAxis
    vector.Unitize()
    p_pre  = pt - (vector * offset_dist)
    p_post = pt + (vector * offset_dist)
    return [rg.Point3d(pt), p_post, p_pre, rg.Point3d(pt)]

def create_corner_tie(pt, vec_in, vec_out, offset_dist):
    if vec_in.IsZero: vec_in = rg.Vector3d.XAxis
    if vec_out.IsZero: vec_out = rg.Vector3d.XAxis
    vec_in.Unitize(); vec_out.Unitize()
    p_pre = pt - (vec_in * offset_dist)
    p_post = pt + (vec_out * offset_dist)
    return [rg.Point3d(pt), p_post, p_pre, rg.Point3d(pt)]

# =========================================================
# Main Logic
# =========================================================

# 1. 準備屬性
typs_colors = [(t, c) for t, c in zip(sorted_types, sorted_colors)]
dressed_pts_nested = []

# 2. 幾何預處理 (建立 EMB 打結與 WIN 端點)
for i, (typ_color, pts) in enumerate(zip(typs_colors, pts_nested)):
    current_typ = typ_color[0]
    current_pts = [rg.Point3d(p) for p in list(pts)]
    seg_len = len(current_pts)
    processed_segment = []

    if current_typ == "EMB":
        for j, pt in enumerate(current_pts):
            if j == 0:
                processed_segment.extend(create_cap_pts(pt, current_pts[j+1], cap_distance) if seg_len > 1 else [pt])
                continue
            elif j == seg_len - 1:
                processed_segment.extend(create_cap_pts(pt, current_pts[j-1], cap_distance) if seg_len > 1 else [pt])
                continue

            # Anchor Tie Check
            prev_pt, next_pt = current_pts[j-1], current_pts[j+1]
            dist_in, dist_out = prev_pt.DistanceTo(pt) * 10, pt.DistanceTo(next_pt) * 10
            
            if dist_in > JUMP_THRESHOLD or dist_out > JUMP_THRESHOLD:
                if dist_in > JUMP_THRESHOLD and dist_out > JUMP_THRESHOLD:
                    processed_segment.extend(create_corner_tie(pt, pt-prev_pt, next_pt-pt, TIE_OFFSET*0.1))
                elif dist_in > JUMP_THRESHOLD:
                    processed_segment.extend(create_linear_tie(pt, pt-prev_pt, TIE_OFFSET*0.1))
                else:
                    processed_segment.extend(create_linear_tie(pt, next_pt-pt, TIE_OFFSET*0.1))
            else:
                processed_segment.append(pt)

    elif current_typ == "WIN":
        if seg_len > 1:
            # 1. 處理中間點 (確保每一點都是新的獨立物件)
            processed_segment.extend([rg.Point3d(p) for p in current_pts[:-1]])
            
            # 2. 處理最後一點 (建立兩個座標相同但「記憶體位址不同」的點)
            last_pt = current_pts[-1]
            p_end1 = rg.Point3d(last_pt) # 複製品 A
            p_end2 = rg.Point3d(last_pt) # 複製品 B
            
            processed_segment.append(p_end1)
            processed_segment.append(p_end2)
        else:
            processed_segment.append(rg.Point3d(current_pts[0]))

    dressed_pts_nested.append(processed_segment)

# 2. 處理 Travel (先在原始座標系生成)
travel_pts_nested = []
for i, pts in enumerate(dressed_pts_nested):
    if i == 0:
        p1, p3 = origin + jump_vec, rg.Point3d(pts[0].X, pts[0].Y, 0) + jump_vec
        travel_pts_nested.append([p1, (p1 + p3) / 2, p3])
    if i < len(dressed_pts_nested) - 1:
        t1 = rg.Point3d(pts[-1].X, pts[-1].Y, 0) + jump_vec
        t3 = rg.Point3d(dressed_pts_nested[i+1][0].X, dressed_pts_nested[i+1][0].Y, 0) + jump_vec
        travel_pts_nested.append([t1, (t1 + t3) / 2, t3])
    if i == len(dressed_pts_nested) - 1:
        h1, h3 = rg.Point3d(pts[-1].X, pts[-1].Y, 0) + jump_vec, origin + jump_vec
        travel_pts_nested.append([h1, (h1 + h3) / 2, h3])

# 3. 合併成一個預覽清單
zip_pts_preview = []
for trav, dress in zip_longest(travel_pts_nested, dressed_pts_nested):
    if trav: zip_pts_preview.append(trav)
    if dress: zip_pts_preview.append(dress)

# 4. 全體鏡像 (這會同時翻轉所有路徑，包括 Travel)
if mirror:
    xform = rg.Transform.Mirror(rg.Plane.WorldYZ)
    for segment in zip_pts_preview:
        for pt in segment:
            # 這裡會直接修改 Point3d 物件的內部座標
            # 因為 zip_pts_preview 引用了所有的點，所以 dressed_pts_nested 也會同步改變
            pt.Transform(xform)

# 5. 存入 OrderedDict (此時 pt.X, pt.Y 已經是鏡像後的數值)
final_ordered_dict = OrderedDict([("INDEX", []), ("X", []), ("Y", []), ("COLOR", []), ("TYPE", [])])
for idx, (pts_list, info) in enumerate(zip(dressed_pts_nested, typs_colors)):
    for pt in pts_list:
        final_ordered_dict["INDEX"].append(idx)
        final_ordered_dict["X"].append(pt.X)
        final_ordered_dict["Y"].append(pt.Y)
        final_ordered_dict["COLOR"].append(info[1])
        final_ordered_dict["TYPE"].append(info[0])

# 6. 輸出
zpts_tree = th.list_to_tree(zip_pts_preview)
out_dict = final_ordered_dict
# ---------- end emb_preprocessor ----------

# ----
# Write / Export . DST
S_2 = Script()  # -> dst_dir
# ---------- S_2: Python ----------
import sys
import os
import Grasshopper

# 1. Get the current Grasshopper file location
# This accesses the document that owns this component
gh_doc = ghenv.Component.OnPingDocument()

if gh_doc.FilePath:
    gh_file_path = gh_doc.FilePath
    gh_dir = os.path.dirname(gh_file_path)      # ...\src\gh

    project_root = os.path.dirname(gh_dir)      
    dst_dir = os.path.normpath(os.path.join(project_root, "..", "data"))
# ---------- end S_2 ----------
writedst = Python3Script(script=item.Item4, in_dict=emb_preprocessor.out_dict, folder_path=S_2, name=panel_2, export=exportdst)  # -> out; inputs folder_path: String, name: String, export: Boolean
#   port script: Script to execute
# ---------- writedst: Python ----------
import os
import math
import pyembroidery

# =========================================================
# Parameters
# =========================================================
JUMP_THRESHOLD = 121  # 12.1mm

if export and in_dict:
    # 1. 初始化 pyembroidery pattern
    pattern = pyembroidery.EmbPattern()
    
    # 取得 dict 內部的 list
    indices = in_dict["INDEX"]
    xs = in_dict["X"]
    ys = in_dict["Y"]
    colors = in_dict["COLOR"]
    types = in_dict["TYPE"]
    
    total_pts = len(xs)

    # 2. 核心轉換邏輯
    for i in range(total_pts):
        # 座標轉換 (Rhino mm -> 0.1mm 單位整數)
        # 注意：DST 座標系 Y 軸與 Rhino 相反，但 pyembroidery 寫入時通常會處理
        # 這裡先依照標準 10 倍縮放
        cur_x = int(xs[i] * 10)
        cur_y = int(ys[i] * 10)
        
        cur_idx = indices[i]
        cur_type = types[i]
        cur_color = colors[i]
        
        # 判定是否為該段落 (Segment) 的最後一針
        is_last_in_seg = (i == total_pts - 1) or (indices[i+1] != cur_idx)
        
        # --- A. 指令判定邏輯 ---
        command = "STITCH" # 預設

        if cur_type == "EMB":
            if is_last_in_seg:
                # 判定下一個 Segment 的顏色
                if i < total_pts - 1:
                    next_color = colors[i+1]
                    if next_color != cur_color:
                        command = "COLOR_CHANGE"
                    else:
                        command = "TRIM"
                else:
                    # 最後一段的最後一針
                    command = "END"
            else:
                # 檢查是否與下一點座標重疊，避免原地落針
                if i < total_pts - 1:
                    if xs[i] == xs[i+1] and ys[i] == ys[i+1]:
                        command = "JUMP"

        elif cur_type == "WIN":
            # 繞線模式：中間點均為 JUMP，結尾兩針觸發 COLOR_CHANGE
            if is_last_in_seg:
                command = "COLOR_CHANGE"
            else:
                # 檢查是否為結尾前的那一個重複點 (我們之前在 dict 存了兩個重複點)
                if i < total_pts - 1 and xs[i] == xs[i+1] and ys[i] == ys[i+1] and indices[i+1] == cur_idx:
                    command = "COLOR_CHANGE"
                else:
                    command = "JUMP"

        # --- B. 長針分割邏輯 (僅針對 STITCH) ---
        # 取得前一點座標以計算距離
        if i > 0:
            prev_x = int(xs[i-1] * 10)
            prev_y = int(ys[i-1] * 10)
            dist = math.sqrt((cur_x - prev_x)**2 + (cur_y - prev_y)**2)
            
            if command == "STITCH" and dist > JUMP_THRESHOLD:
                steps = int(math.ceil(dist / float(JUMP_THRESHOLD)))
                for k in range(1, steps):
                    inter_x = int(prev_x + (cur_x - prev_x) * k / steps)
                    inter_y = int(prev_y + (cur_y - prev_y) * k / steps)
                    pattern.add_stitch_absolute(pyembroidery.JUMP, inter_x, inter_y)

        # --- C. 寫入 pyembroidery 指令 ---
        py_cmd = pyembroidery.STITCH # 預設轉換
        if command == "JUMP": py_cmd = pyembroidery.JUMP
        elif command == "COLOR_CHANGE": py_cmd = pyembroidery.COLOR_CHANGE
        elif command == "TRIM": py_cmd = pyembroidery.TRIM
        elif command == "END": py_cmd = pyembroidery.END
        
        pattern.add_stitch_absolute(py_cmd, cur_x, cur_y)

    # 3. 輸出檔案
    if not os.path.exists(folder_path):
        os.makedirs(folder_path)
    
    full_path = os.path.join(folder_path, name + ".dst")
    csv_path = os.path.join(folder_path, name + ".csv")
    pyembroidery.write(pattern, full_path)
    pyembroidery.convert(full_path, csv_path)

    
    print("Successfully exported: {}".format(full_path))
else:
    if not export:
        print("Export is set to False.")
    if not in_dict:
        print("No input dictionary found.")
# ---------- end writedst ----------

# ----
# Path Visualization
pt_3 = Point(emb_preprocessor.zpts_tree)  # disabled
intcrv = Interpolate(Vertices=pt_3, Degree=1, Periodic=False, KnotStyle=1)  # -> flatten(Curve), Length, Domain; disabled
lng = ListLength(List=intcrv.Curve)  # disabled
repeat = RepeatData(Data=[swatch_3, swatch_4], Length=lng)  # -> graft(Data); disabled
repeat_2 = RepeatData(Data=[swatch, swatch_2], Length=lng)  # disabled
repeat_3 = RepeatData(Data=[panel_4, panel_5], Length=lng)  # disabled
crvdis = CurveDisplay(Curve=intcrv.Curve, Color=repeat_2, Thickness=repeat_3)  # disabled
pointdis = PointDisplay(Point=pt_3, Color=repeat, Radius=2, Type=3)  # disabled

# ----
# Output CSV Status
panel_8 = Panel(writedst)

# ---- group: Sequencing
qfdm = HS_QuickFDM(Plane=PlaneXY(0, 0, 0), Infill=flatten(crv), ProximityTolerance=0.01, CombineTolerance=0.01, StartPoint=pt_2)  # -> PathSequence, Indices, SegmentType, Flipped; disabled
expression = Expression(x=qfdm.SegmentType, y="Infill", Expression="x=y")

# ----
panel_9 = Panel(qfdm.SegmentType)
expression_2 = Expression(x=qfdm.SegmentType, y="Travel", Expression="x=y")
cull = CullPattern(List=qfdm.PathSequence, CullPattern=expression)

# ---- group: Sequencing (continued)
cull_2 = CullPattern(List=qfdm.PathSequence, CullPattern=expression_2)
sequenced_infill = Data(cull)
travels = Data(graft(cull_2))
